# Grasshopper definition GA_generico.gh (Grasshopper 0.9.76)
# plug-ins: Python Interpreter

# ---- group: Launcher
toggle = BooleanToggle(True)

# ----
python = PythonScript(Toggle=toggle)  # -> out, a
# ---------- python: Python ----------
"""
Created on Mon May 14 15:18 PM 2020
@author: Renato Godoi da Cruz
email: renatogcruz@hotmail.com
github: github.com/renatogcruz
"""

class Parametro():
    def __init__(self, nome, minimo, maximo): #o valor entra nesse algoritmo
        self.nome = nome
        self.minimo = minimo
        self.maximo = maximo

if Toggle:
    lista_parametros = []
    lista_parametros.append(Parametro('Altura', 1.00, 5.00))
    lista_parametros.append(Parametro('Largura', 1.00, 10.00))
    lista_parametros.append(Parametro('Profundidade', 5.00, 20.00))
    for parametro in lista_parametros:
        print(parametro.nome)
# ---------- end python ----------
panel = Panel(python.out)
