# Grasshopper definition GA_passo_a_passo.gh (Grasshopper 0.9.76)
# plug-ins: Python Interpreter

python = PythonScript()  # -> out, a
# ---------- python: Python ----------
"""
Created on April 18, 2020
    @author: Renato Godoi da Cruz
    email: renatogcruz@hotmail.com
"""

class Produto():
    """Creates the product class"""
    def __init__(self, nome, espaco, valor):
        self.nome = nome
        self.espaco = espaco
        self.valor = valor

if __name__ == '__main__':
    #p1 = Produto('Iphone', 0.0000899, 2199.12)
    lista_produtos = []
    lista_produtos.append(Produto('Geladeira Dako', 0.751, 999.90))
    lista_produtos.append(Produto('Iphone 6', 0.0000899, 2199.12))
    lista_produtos.append(Produto("TV 55'", 0.400, 4346.99))
    lista_produtos.append(Produto("TV 50'", 0.290, 3999.90))
    lista_produtos.append(Produto("TV 42'", 0.200, 2999.00))
    lista_produtos.append(Produto("Notebook Dell", 0.00350, 2499.90))
    lista_produtos.append(Produto("Ventilador Panasonic", 0.496, 199.90))
    lista_produtos.append(Produto("Microondas Eletrolux", 0.0424, 308.66))
    lista_produtos.append(Produto("Microondas LG", 0.0544, 429.90))
    lista_produtos.append(Produto("Microondas Panasonic", 0.0319, 299.29))
    lista_produtos.append(Produto("Geladeira Brastemp", 0.635, 849.00))
    lista_produtos.append(Produto("Geladeira Consul", 0.870, 1199.89))
    lista_produtos.append(Produto("Notebook Lenovo", 0.498, 1999.90))
    lista_produtos.append(Produto("Notebook Asus", 0.527, 3999.00))

    for produto in lista_produtos:
        #print(produto)
        print(produto.nome)
# ---------- end python ----------
print = Panel(python.out)
